% Simulink data dictionary EgasPOC.sldd

WSS_Avg_Spd = Simulink.Parameter(3)
Whl_Stuck_Delta = Simulink.Parameter(0.08)
Wheel_Spd_Th = Simulink.Parameter(3)
Stuck_Th_Cyc = Simulink.Parameter(100)
Motor_Stuck_Delta = Simulink.Parameter(0.05)
IMU_Stuck_Delta = Simulink.Parameter(0.05)

SG_mWhdStat_IDT_E2E = Simulink.Bus(HeaderFile="Rte_Type.h")
  HwEnblStat: boolean
  MsgCntr_mWhdStat: uint8
  MsgCrc_mWhdStat: uint8
  MtrSpd: single
  MtrTrqEst: single
  MvCurrEst: single
  MvVolt: single
  TrqEnblStat: boolean
  CanVm64FltCod: uint8

SG_mVcuImuLinAccel_IDT = Simulink.Bus(HeaderFile="Rte_Type.h")
  MsgCntr_ImuLin: uint8
  MsgCrc_ImuLin: uint8
  X_Accel: single
  Y_Accel: single
  Z_Accel: single

SG_mEbcm2L_WhlSpd_IDT_E2E = Simulink.Bus(HeaderFile="Rte_Type.h")
  MsgCntr_mEbcm2L_WhlSpd: uint8
  MsgCrc_mEbcm2L_WhlSpd: uint8
  WhlSpdFL: single
  WhlSpdFR: single
  WhlSpdR: single
  CanVm7FFltCod: uint8

IF_ValidityFlag_L1p_IDT = Simulink.Bus(HeaderFile="Rte_Type.h")
  Motor_RPM_Valid_Flg: boolean
  WSS_FR_Valid_Flg: boolean
  WSS_FL_Valid_Flg: boolean
  WSS_R_Valid_Flg: boolean
  IMU_AccelX_Valid_Flg: boolean
  SensorStuck_Valid_Flg: boolean

IF_SensorFaultFlgs_L2p_IDT = Simulink.Bus(HeaderFile="Rte_Type.h")
  MotorRPM_Fault: boolean
  Accel_Fault: boolean
  WSS_Fault: boolean
  VechSpeedEst_Fault: boolean

w_accel2 = Simulink.Parameter(0.25)
w_accel1 = Simulink.Parameter(0.75)

SG_mVehCtrlADRq_IDT_E2E = Simulink.Bus(HeaderFile="Rte_Type.h")
  AebEvent: boolean
  AebSrcAD: uint8
  b_High_Deceleration_Flag: boolean
  MsgCntrmVehCtrlADRq: uint8
  MsgCrc_mVehCtrlADRq: uint8
  VehAccelLongCmd: single
  VehDirCmd: uint8
  VehRoadWhlAngleCmd: single
  VehSpdCmd: single
  CanAd78FltCod: uint8

Ki = Simulink.Parameter(0.7)
Kp = Simulink.Parameter(4)

SafetyMode_L2p_IDT = enum(HeaderFile="Rte_Type.h", DefaultValue="AUTONOMOUS", StorageType="uint8")
  AUTONOMOUS = 1
  MANUAL = 0
  TELEOPS = 3

WhlSpd_Max = Simulink.Parameter(32, StorageClass="Const", DataType="uint16")

AutonomousMode = enum(DefaultValue="AutonomousNotAllowed", StorageType="int8")
  AutonomousNotAllowed = 0
  AutonomousAllowed = 1

DT = Simulink.Parameter(0.01)
WhlSpd_Min = Simulink.Parameter(0, StorageClass="Const", DataType="uint16")

VechSafetyStatus_L2p_IDT = enum(HeaderFile="Rte_Type.h", DefaultValue="NORMAL", StorageType="uint8")
  NORMAL = 0
  DEGRADED = 1
  FAULT_STOP = 2
  OVERSPEED_HANDLING = 3

SG_mBrkCtrl_IDT = Simulink.Bus(HeaderFile="Rte_Type.h")
  Aeb_Active_Ebcm: boolean
  BrkEnbl_EBCM2L: boolean
  BrkTrqRq: single
  ClearFltRq_Ebcm: boolean
  DsblTCS: boolean
  EbcmMaintModeRq: boolean
  EbcmShtdwnRq: boolean
  EpbCalCmd: boolean
  EPBCmd: uint8
  HoldRq: boolean
  MsgCntr_mBrkCtrl: uint8
  MsgCrc_mBrkCtrl: uint8

SG_mWhdCtrl_IDT = Simulink.Bus(HeaderFile="Rte_Type.h")
  Boot: boolean
  CtrlMode_Whd: uint8
  Debug: boolean
  EnblCmd: boolean
  MsgCntr_mWhdCtrl: uint8
  MsgCrc_mWhdCtrl: uint8
  MtrMode: uint8
  SpdCmd: single
  SpdSlewLmt: single
  TrqCmd: single
  TrqSlewLmt: single