% Simulink data dictionary Egas_SW1.sldd

IF_ValidityFlag_L1p_IDT = Simulink.Bus(HeaderFile="Rte_Type.h")
  Motor_RPM_Valid_Flg: boolean
  WSS_FR_Valid_Flg: boolean
  WSS_FL_Valid_Flg: boolean
  WSS_R_Valid_Flg: boolean
  IMU_AccelX_Valid_Flg: boolean

SG_mEbcm2L_WhlSpd_IDT_E2E = Simulink.Bus(HeaderFile="Rte_Type.h")
  MsgCntr_mEbcm2L_WhlSpd: uint8
  MsgCrc_mEbcm2L_WhlSpd: uint8
  WhlSpdFL: single
  WhlSpdFR: single
  WhlSpdR: single
  CanVm7FFltCod: uint8

SG_mVcuImuLinAccel_IDT = Simulink.Bus(HeaderFile="Rte_Type.h")
  MsgCntr_ImuLin: uint8
  MsgCrc_ImuLin: uint8
  X_Accel: single
  Y_Accel: single
  Z_Accel: single

SG_mWhdStat_IDT_E2E = Simulink.Bus(HeaderFile="Rte_Type.h")
  HwEnblStat: boolean
  MsgCntr_mWhdStat: uint8
  MsgCrc_mWhdStat: uint8
  MtrSpd: single
  MtrTrqEst: single
  MvCurrEst: single
  MvVolt: single
  TrqEnblStat: boolean
  CanVm64FltCod: uint8

WhlSpd_Min = Simulink.Parameter(0)
WhlSpd_Max = Simulink.Parameter(32)
Accel_Max = Simulink.Parameter(32.767)
Motor_Spd_Min = Simulink.Parameter(0)
Motor_Spd_Max = Simulink.Parameter(1023)
WSS_Avg_Spd = Simulink.Parameter(3)
Wheel_Spd_Th = Simulink.Parameter(3)
Whl_Stuck_Delta = Simulink.Parameter(0.08)
IMU_Stuck_Delta = Simulink.Parameter(0.05)
Motor_Stuck_Delta = Simulink.Parameter(0.05)
Stuck_Th_Cyc = Simulink.Parameter(100)